# Grasshopper definition radiation_verified_checkpoint.gh (Grasshopper 1.0.8)

# ---- group: 00_INPUT
epw_seattle_bundled_smoke_fixture = Panel("C:/Program Files/ladybug_tools/resources/weather/USA_WA_Seattle-Tacoma.Intl.AP.727930_TMYx.2004-2018/USA_WA_Seattle-Tacoma.Intl.AP.727930_TMYx.2004-2018.epw")
grid_model_units_1_metre = Panel("100.0")
run_folder = Panel("C:\Users\08432.SINOLTD\00.DEVE\31.AEC\RHINO_Deve\EnvironmentalSimulationHub\samples\radiation_smoke")
run = Panel("True")
north_degrees = Panel("0")
cpu_count = Panel("1")
analysisgeometry_4m_x_4m = Brep(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)

# ---- group: 10_PREPROCESS / EPW
importepw = LBImportEPW(epw_file=epw_seattle_bundled_smoke_fixture)  # -> location, dry_bulb_temperature, dew_point_temperature, relative_humidity, wind_speed, wind_direction, direct_normal_rad, diffuse_horizontal_rad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; plug-in component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

# ---- group: 40_SOLVER / Radiance gendaymtx + Ladybug
skymatrix = LBCumulativeSkyMatrix(
    north=north_degrees,
    location=importepw.location,
    direct_rad=importepw.direct_normal_rad,
    diffuse_rad=importepw.diffuse_horizontal_rad,
    folder=run_folder)  # -> report, sky_mtx; plug-in component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
incidentradiation = LBIncidentRadiation(
    sky_mtx=skymatrix.sky_mtx,
    geometry=flatten(analysisgeometry_4m_x_4m),
    grid_size=grid_model_units_1_metre,
    cpu_count=cpu_count,
    run=run)  # -> report, points, results, total, mesh, legend, title, int_mtx; plug-in component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
